# Grasshopper definition PointCloud.gh (Grasshopper 1.0.7)

decimation_filter_magnitude = Slider(7, range=1..8)
press_to_get_latest_frame = Button()
# - Make sure you installed BENGESHT plugin
# - Start realsense_pointcloud_server\python\realsense_server_websocket.py first
# - For instructions, refer to README.md
panel = Panel("ws://localhost:8787")
websocket_client_start = WebsocketClientStart(Address=panel, InitalMessage=decimation_filter_magnitude, Reset=press_to_get_latest_frame)
websocket_client_receiver = WebsocketClientReceiver(WebsocketObjects=websocket_client_start, AutoUpdate=True)  # -> Message, Status
scale_factor = Slider(1000, range=0..1000)
python = GhPythonScript(msg=websocket_client_receiver.Message)  # -> out, points_out
# ---------- python: Python ----------
import json
import rhinoscriptsyntax as rs


points_out = []
if msg is not None:
    points = json.loads(msg)
    points_out = [rs.CreatePoint(x,y,z) for (x,y,z) in points]
    print (len(points))
# ---------- end python ----------
lng = ListLength(List=python.points_out)
scale = Scale(Geometry=python.points_out, Center=Point(0, 0, 0), Factor=scale_factor)  # -> Geometry, Transform
number_of_points = Panel(lng)
